# Grasshopper definition master_file.gh (Grasshopper 1.0.7)

expression = Expression(Expression="π")

# ----
# IMPORT_OBJ
# Rotate if necesary
rotate_bool = BooleanToggle(False)
# Right_click / select existing file
file_path = FilePath("C:\Users\JesusBarney\Desktop\ETH\THESIS\08_Github\eggShell2.0\06_Prints\20190826\20190826_cantilevered overhanging_corrected.obj")
# Scale factor
scale_factor_mesh = Slider(10, range=0..15)
python_script = PythonScript(path=file_path, rotate_bool=rotate_bool, rotate_angle=expression, scale_factor=scale_factor_mesh)  # -> out, mesh, z_values, face_centers; inputs rotate_bool: Boolean
# ---------- python_script: Python ----------
import importObj
reload(importObj)

from importObj import ImportObj
import Rhino.Geometry as rg

imported_mesh = ImportObj(path, rotate_bool, scale_factor)

imported_mesh.import_obj()

if rotate_bool:
    
    imported_mesh.rotate_mesh(rotate_angle)

if scale_factor != 1:
    
    imported_mesh.scale_mesh()

imported_mesh.get_bounding_box()

imported_mesh.move_mesh()

imported_mesh.calc_normals()

z_values = imported_mesh.z_values
face_centers = imported_mesh.face_centers
mesh = imported_mesh.mesh
# ---------- end python_script ----------
# SLICER
mesh = Mesh(python_script.mesh)

# ---- group: check correct printing part, then SEND
data_dam = DataDam(DataDataA=mesh, BufferDelay=10000000, BufferMode=0)

# ----
write_file = Button()
directory_path = FilePath("C:\Users\JesusBarney\Desktop\ETH\THESIS\08_Github\eggShell2.0\04_Code\02_Slicer\data\tests\")
geo = Geometry(<point referenced from the Rhino model>)
mesh_2 = Mesh(data_dam)

# ----
# SLOPE_VISUALIZATION
toggle = BooleanToggle(False)
cull = CullPattern(List=python_script.z_values, CullPattern=toggle)
gradient = Gradient(
    LowerLimit=0,
    UpperLimit=1,
    Parameter=expr("(1-abs(x))", cull),
    stops=[0: RGB(255, 0, 0), 0.114: RGB(253, 54, 40), 0.473: RGB(255, 255, 0), 0.895: RGB(0, 128, 0)])
preview = CustomPreview(Geometry=python_script.face_centers, Shader=gradient)

# ----
# SLICER
python = GhPythonScript(mesh=mesh_2, write_file=write_file, dir_path=directory_path, attractor_points=geo)  # -> out, slice, contour_curves, all_points, seams, layer_height, frame_list; inputs mesh: Mesh, write_file: Boolean, attractor_points: list of Point3d
# ---------- python: Python ----------
"""import Slice
"""
import slice
reload(slice)
from slice import Slice

import parameters.slice_args
reload(parameters.slice_args)
from parameters.slice_args import sliceargs


"""import generateWCS
"""
import generateWCS
reload(generateWCS)
from generateWCS import GenerateWCS

import parameters.wcs_args
reload(parameters.wcs_args)
from parameters.wcs_args import wcsargs


"""import writeTxt
"""
import writeTxt
reload(writeTxt)
from writeTxt import WriteTxt

import parameters.write_text_args
reload(parameters.write_text_args)
from parameters.write_text_args import writetxtargs


"""slice
"""
sliceargs['attractor_points']    = attractor_points
slice = Slice(**sliceargs)
slice_curves = slice.contour_mesh(mesh)

contour_curves = [s.curve for s in slice_curves]
seams = [s.curve.PointAtStart for s in slice_curves]


"""generate WCS frames
"""
wcsargs['layer_height']  = slice.layer_height
generateWCS = GenerateWCS(**wcsargs)
WCS_list, all_points = generateWCS.generate_WCS_frames(slice_curves)


"""write txt file
"""
if write_file:
    
    writetxtargs['data']      = WCS_list
    writetxtargs['dir_path']  = dir_path
    
    write_txt = WriteTxt(**writetxtargs)
    write_txt.write_txt_file()
# ---------- end python ----------

geo_2 = Geometry(python.frame_list)

# ---- group: contour_curves
geo_3 = Geometry(python.contour_curves)

# ---- group: all_points
geo_4 = Geometry(python.all_points)

# ---- group: seams
geo_5 = Geometry(python.seams)

# ----
cls = Closed(Curve=geo_3)  # -> Closed, Periodic
split = SplitList(List=geo_4, Index=Slider(50000, range=0..50000))  # -> ListA, ListB
panel = Panel(cls.Closed)
pline = PolyLine(Vertices=split.ListA, Closed=False)
geo_6 = Geometry()
geo_7 = Geometry()
